# Grasshopper definition pointcloud_subscriber.gh (Grasshopper 1.0.7)
# plug-ins: Volvox, Tarsier

# point cloud subscription subscription
panel = Panel("192.168.126.129")
toggle = BooleanToggle(False)  # disabled
# /joint_states subscription
panel_2 = Panel("172.16.21.68")  # disabled
ros = ROSConnect(ip=panel, connect=Toggle(True))  # -> ros_client, is_connected; inputs port: Int32, connect: Boolean
#   port ip: The ip address ROS. Defaults to 127.0.0.1.
#   port port: The port of ROS. Defaults to 9090.
#   port connect: If True, connects to ROS. If False, disconnects from ROS. Defaults to False.
#   port ros_client: The ROS client.
#   port is_connected: True if connection established.
# ---------- ros: Python ----------
"""
Connect or disconnect to ROS.

COMPAS FAB v0.27.0
"""
from ghpythonlib.componentbase import executingcomponent as component
from scriptcontext import sticky as st

from compas_fab.backends import RosClient
from compas_fab.ghpython.components import create_id


class ROSConnect(component):
    def RunScript(self, ip, port, connect):
        ros_client = None

        ip = ip or '127.0.0.1'
        port = port or 9090

        key = create_id(self, 'ros_client')
        ros_client = st.get(key, None)

        if ros_client:
            st[key].close()
        if connect:
            st[key] = RosClient(ip, port)
            st[key].run(5)

        ros_client = st.get(key, None)
        is_connected = ros_client.is_connected if ros_client else False
        return (ros_client, is_connected)
# ---------- end ros ----------
ros_2 = ROSConnect(ip=panel_2, connect=toggle)  # -> ros_client, is_connected; inputs port: Int32, connect: Boolean; disabled; same code as ros
panel_3 = Panel("/sensor_msgs/JointState")  # disabled
button = Button()  # disabled
button_2 = Button()  # disabled
panel_4 = Panel("/joint_states")  # disabled
subscribe = SubscribeToTopic(
    ros_client=ros.ros_client,
    topic_name="/cropped_point_cloud",
    topic_type="/sensor_msgs/PointCloud",
    start=Button(),
    stop=Button())  # -> topic, last_msg, is_subscribed; inputs interval: Int32, start: Boolean, stop: Boolean
#   port ros_client: The ROS client.
#   port topic_name: Name of the topic to subscribe to, eg. /joint_states
#   port topic_type: Type of the topic to subscribe to, eg. sensor_msgs/JointState
#   port interval: Interval in milliseconds at which to expire the solution to propagate received messages. Defaults to 25ms. Messages are not queued, so if the interval is greater than the rate at which messages are published, some messages will be dropped.
#   port start: Start receiving messages.
#   port stop: Stop receiving messages.
#   port topic: The subscribed topic instance.
#   port last_msg: The last received message.
#   port is_subscribed: Indicates if the topic is currently subscribed or not.
# ---------- subscribe: Python ----------
"""
Subscribe to a ROS topic.

COMPAS FAB v0.27.0
"""
import time

import Grasshopper.Kernel
from ghpythonlib.componentbase import executingcomponent as component
from roslibpy import Topic
from scriptcontext import sticky as st

from compas_fab.backends.ros.messages import ROSmsg
from compas_fab.ghpython.components import create_id


class ROSTopicSubscribe(component):
    def RunScript(self, ros_client, topic_name, topic_type, interval, start, stop):
        if not topic_name:
            raise ValueError('Please specify the name of the topic')
        if not topic_type:
            raise ValueError('Please specify the type of the topic')

        if not hasattr(self, 'message_count'):
            self.message_count = 0

        self.interval = interval or 25  # in milliseconds
        self.is_updating = False
        self.is_subscribed = False

        self.msg_key = create_id(self, 'last_msg')
        key = create_id(self, 'topic')

        last_msg = st.get(self.msg_key, None)
        topic = st.get(key, None)

        if ros_client and ros_client.is_connected:
            if start:
                self._unsubscribe(topic)

                topic = Topic(ros_client, topic_name, topic_type)
                topic.subscribe(self.topic_callback)
                time.sleep(0.2)

                st[key] = topic

            if stop:
                self._unsubscribe(topic)

        self.is_subscribed = topic and topic.is_subscribed

        if last_msg:
            last_msg = ROSmsg.parse(last_msg, topic_type)

        if self.is_subscribed:
            self.Message = 'Subscribed, {} messages'.format(self.message_count)
        else:
            self.Message = 'Not subscribed'

        return (topic, last_msg, self.is_subscribed)

    def _unsubscribe(self, topic):
        if topic and topic.is_subscribed:
            topic.unsubscribe()
            time.sleep(0.2)

    def topic_callback(self, msg):
        self.message_count += 1
        st[self.msg_key] = msg

        if self.is_subscribed:
            ghdoc = ghenv.Component.OnPingDocument()     # noqa: F821 This is defined by Grasshopper
            if not self.is_updating and ghdoc.SolutionState != Grasshopper.Kernel.GH_ProcessStep.Process:
                self.is_updating = True
                ghdoc.ScheduleSolution(
                    self.interval, Grasshopper.Kernel.GH_Document.GH_ScheduleDelegate(self.expire_callback))

    def expire_callback(self, ghdoc):
        if ghdoc.SolutionState != Grasshopper.Kernel.GH_ProcessStep.Process:
            ghenv.Component.ExpireSolution(False)        # noqa: F821 This is defined by Grasshopper
        self.is_updating = False
# ---------- end subscribe ----------
subscribe_2 = SubscribeToTopic(ros_client=ros_2.ros_client, topic_name=panel_4, topic_type=panel_3, start=button, stop=button_2)  # -> topic, last_msg, is_subscribed; inputs interval: Int32, start: Boolean, stop: Boolean; disabled; same code as subscribe
ghpython_script = GhPythonScript(x=subscribe_2.last_msg)  # -> out, a; disabled
# ---------- ghpython_script: Python ----------
__author__ = "ainho"
__version__ = "2024.01.19"

import rhinoscriptsyntax as rs

print(x)
a = x.position
# ---------- end ghpython_script ----------
ghpython_script_2 = GhPythonScript(x=subscribe.last_msg)  # -> out, x, y, z, rgb
# ---------- ghpython_script_2: Python ----------
import rhinoscriptsyntax as rs
from System.Drawing import Color


point_array = x.points
color_array = x.channels

x = []
y = []
z = []
rgb = []

for i in range (0, len(point_array)-1):
    values = point_array[i].values()
    x.append(values[0])
    y.append(values[1])
    z.append(values[2])
    
    values2 = color_array[i].values()[0]
    clr = Color.FromArgb(values2[0], values2[1], values2[2])
    rgb.append(clr)
# ---------- end ghpython_script_2 ----------
panel_5 = Panel(ghpython_script.a)  # disabled
construct_point = ConstructPoint(XCoordinate=ghpython_script_2.x, YCoordinate=ghpython_script_2.y, ZCoordinate=ghpython_script_2.z)
point = Point(construct_point)
construct_cloud = ConstructCloud(Points=point, Colors=ghpython_script_2.rgb)
preview_point_cloud = PreviewPointCloud(PointCloud=construct_cloud, Weight=Slider(4, range=1..100))
