# Grasshopper definition pose_and_pose_array_pub.gh (Grasshopper 1.0.7)

pt = ConstructPoint(XCoordinate=Slider(841, range=0..10000), YCoordinate=0, ZCoordinate=Slider(253, range=0..1000))
ros = ROSConnect(ip="192.168.1.1", connect=Toggle(False))  # -> ros_client, is_connected; inputs port: Int32, connect: Boolean
#   port ip: The ip address ROS. Defaults to 127.0.0.1.
#   port port: The port of ROS. Defaults to 9090.
#   port connect: If True, connects to ROS. If False, disconnects from ROS. Defaults to False.
#   port ros_client: The ROS client.
#   port is_connected: True if connection established.
# ---------- ros: Python ----------
"""
Connect or disconnect to ROS.

COMPAS FAB v0.27.0
"""
from ghpythonlib.componentbase import executingcomponent as component
from scriptcontext import sticky as st

from compas_fab.backends import RosClient
from compas_fab.ghpython.components import create_id


class ROSConnect(component):
    def RunScript(self, ip, port, connect):
        ros_client = None

        ip = ip or '127.0.0.1'
        port = port or 9090

        key = create_id(self, 'ros_client')
        ros_client = st.get(key, None)

        if ros_client:
            st[key].close()
        if connect:
            st[key] = RosClient(ip, port)
            st[key].run(5)

        ros_client = st.get(key, None)
        is_connected = ros_client.is_connected if ros_client else False
        return (ros_client, is_connected)
# ---------- end ros ----------
polygon = Polygon(Plane=pt, Radius=Slider(98, range=0..1000), Segments=6, FilletRadius=0)  # -> Polygon, Length
divide = DivideCurve(Curve=polygon.Polygon, Count=1, Kinks=True)  # -> Points, Tangents, Parameters
pt_2 = ConstructPoint(XCoordinate=Slider(841, range=0..10000), YCoordinate=0, ZCoordinate=Slider(418, range=0..1000))
xy = XYPlane(Origin=Point(0, 0, 0))
xy_2 = XYPlane(Origin=pt_2)
pl = ConstructPlane(Origin=divide.Points, XAxis=expr("-x", Vector(1, 0, 0)), YAxis=Vector(0, 1, 0))
xy_3 = XYPlane(Origin=Point(0, 0, 0))
pose_stamped_msg = GhPythonScript(origin=xy, plane=xy_2)  # -> out, msg; inputs origin: Plane, plane: Plane
# ---------- pose_stamped_msg: Python ----------
# inputs > name/typehint/access 
#   > client/roslibpy.ROS/item
#   > param name/str/item
#   > origin/plane/item
#   > planes/plane/tree 

import math
import rhinoscriptsyntax as rs
import Rhino.Geometry as rg
import roslibpy
import json

def pose_msg(pose):
    msg = {'header': { 'seq': 0, 'stamp' : str(roslibpy.Time.now()), 'frame_id':'base_link'},
    'pose':{'position': {'x': pose[0], 'y': pose[1], 'z': pose[2]}, 'orientation': {
                         'w': pose[3], 'x': pose[4], 'y': pose[5], 'z': pose[6]}}}
    return json.dumps(msg)


def plane_to_pose(frame_origin, frame):

    matrix = rg.Transform.PlaneToPlane(frame_origin, frame).Transpose()
    trace = matrix.M00 + matrix.M11 + matrix.M22

    q = rg.Quaternion()

    if trace > 0.0:
        s = math.sqrt(trace + 1.0)
        q.A = s * 0.5
        s = 0.5 / s
        q.B = (matrix.M12 - matrix.M21) * s
        q.C = (matrix.M20 - matrix.M02) * s
        q.D = (matrix.M01 - matrix.M10) * s
    else:
        if matrix.M00 >= matrix.M11 and matrix.M00 >= matrix.M22:
            s = math.sqrt(1.0 + matrix.M00 - matrix.M11 - matrix.M22)
            inv_s = 0.5 / s
            q.B = 0.5 * s
            q.C = (matrix.M01 + matrix.M10) * inv_s
            q.D = (matrix.M02 + matrix.M20) * inv_s
            q.A = (matrix.M12 - matrix.M21) * inv_s
        elif matrix.M11 > matrix.M22:
            s = math.sqrt(1.0 + matrix.M11 - matrix.M00 - matrix.M22)
            inv_s = 0.5 / s
            q.B = (matrix.M10 + matrix.M01) * inv_s
            q.C = 0.5 * s
            q.D = (matrix.M21 + matrix.M12) * inv_s
            q.A = (matrix.M20 - matrix.M02) * inv_s
        else:
            s = math.sqrt(1.0 + matrix.M22 - matrix.M00 - matrix.M11)
            inv_s = 0.5 / s
            q.B = (matrix.M20 + matrix.M02) * inv_s
            q.C = (matrix.M21 + matrix.M12) * inv_s
            q.D = 0.5 * s
            q.A = (matrix.M01 - matrix.M10) * inv_s

    return [frame.OriginX/1000, frame.OriginY/1000, frame.OriginZ/1000, q.A, q.B, q.C, q.D]

msg = pose_msg(plane_to_pose(origin,plane))
# ---------- end pose_stamped_msg ----------
pose_array_msg = GhPythonScript(origin=xy_3, planes=pl)  # -> out, msg; inputs origin: Plane, planes: list of Plane
# ---------- pose_array_msg: Python ----------
# inputs > name/typehint/access 
#   > client/roslibpy.ROS/item
#   > topic/str/item
#   > origin/plane/item
#   > planes/plane/tree 

import rhinoscriptsyntax as rs
import Rhino.Geometry as rg
import math
import roslibpy
import json

def pose_array_msg():
        msg = {'header': { 'seq': 0, 'stamp' : str(roslibpy.Time.now()), 'frame_id':'base_link'},
               'poses': load_poses()}
        return json.dumps(msg)

def load_poses():
    poses = []
    for plane in planes:
        pose = plane_to_pose(origin, plane)
        pose ={'position': {'x': pose[0], 'y': pose[1], 'z': pose[2]},
                'orientation': {'w': pose[3], 'x': pose[4], 'y': pose[5],'z': pose[6]}}
        poses.append(pose)
    return poses

def plane_to_pose(frame_origin, frame):

    matrix = rg.Transform.PlaneToPlane(frame_origin, frame).Transpose()
    trace = matrix.M00 + matrix.M11 + matrix.M22

    q = rg.Quaternion()

    if trace > 0.0:
        s = math.sqrt(trace + 1.0)
        q.A = s * 0.5
        s = 0.5 / s
        q.B = (matrix.M12 - matrix.M21) * s
        q.C = (matrix.M20 - matrix.M02) * s
        q.D = (matrix.M01 - matrix.M10) * s
    else:
        if matrix.M00 >= matrix.M11 and matrix.M00 >= matrix.M22:
            s = math.sqrt(1.0 + matrix.M00 - matrix.M11 - matrix.M22)
            inv_s = 0.5 / s
            q.B = 0.5 * s
            q.C = (matrix.M01 + matrix.M10) * inv_s
            q.D = (matrix.M02 + matrix.M20) * inv_s
            q.A = (matrix.M12 - matrix.M21) * inv_s
        elif matrix.M11 > matrix.M22:
            s = math.sqrt(1.0 + matrix.M11 - matrix.M00 - matrix.M22)
            inv_s = 0.5 / s
            q.B = (matrix.M10 + matrix.M01) * inv_s
            q.C = 0.5 * s
            q.D = (matrix.M21 + matrix.M12) * inv_s
            q.A = (matrix.M20 - matrix.M02) * inv_s
        else:
            s = math.sqrt(1.0 + matrix.M22 - matrix.M00 - matrix.M11)
            inv_s = 0.5 / s
            q.B = (matrix.M20 + matrix.M02) * inv_s
            q.C = (matrix.M21 + matrix.M12) * inv_s
            q.D = 0.5 * s
            q.A = (matrix.M01 - matrix.M10) * inv_s
            
        

    return [frame.OriginX/1000, frame.OriginY/1000, frame.OriginZ/1000, q.A, q.B, q.C, q.D]

msg = pose_array_msg()
# ---------- end pose_array_msg ----------
trigger = Trigger(Interval=1000, TimerInterval=1000, Target=publish)  # disabled
publish = PublishToTopic(
    ros_client=ros.ros_client,
    topic_name="gh_client_pose",
    topic_type="/geometry_msgs/PoseStamped",
    msg=pose_stamped_msg.msg)  # -> topic, is_advertised
#   port ros_client: The ROS client.
#   port topic_name: Name of the topic to publish to, eg. /joint_states
#   port topic_type: Type of the topic to publish to, eg. sensor_msgs/JointState
#   port msg: The message to publish. It can be an instance of ROSMsg, a Python dict, or a JSON string.
#   port topic: The topic instance.
#   port is_advertised: Indicates if the topic is current advertised or not.
# ---------- publish: Python ----------
"""
Publishes messages to a ROS topic

COMPAS FAB v0.27.0
"""
import time

from ghpythonlib.componentbase import executingcomponent as component
from roslibpy import Topic
from scriptcontext import sticky as st

from compas_fab.backends.ros.messages import ROSmsg
from compas_fab.ghpython.components import create_id


class ROSTopicPublish(component):
    def RunScript(self, ros_client, topic_name, topic_type, msg):
        if not topic_name:
            raise ValueError('Please specify the name of the topic')
        if not topic_type:
            raise ValueError('Please specify the type of the topic')

        key = create_id(self, 'topic')

        topic = st.get(key, None)

        if ros_client and ros_client.is_connected:
            if not topic or topic.ros != ros_client:
                topic = Topic(ros_client, topic_name, topic_type, reconnect_on_close=False)
                topic.advertise()
                time.sleep(0.2)

                st[key] = topic

        self.is_advertised = topic and topic.is_advertised

        if msg:
            msg = ROSmsg.parse(msg, topic_type)
            topic.publish(msg.msg)
            self.Message = 'Message published'
        else:
            if self.is_advertised:
                self.Message = 'Topic advertised'

        return (topic, self.is_advertised)
# ---------- end publish ----------
trigger_2 = Trigger(Interval=1000, TimerInterval=1000, Target=publish_2)  # disabled
publish_2 = PublishToTopic(
    ros_client=ros.ros_client,
    topic_name="gh_client_pose_array",
    topic_type="/geometry_msgs/PoseArray",
    msg=pose_array_msg.msg)  # -> topic, is_advertised; same code as publish
