# Grasshopper definition turtlesim.gh (Grasshopper 1.0.7)

linear_vel = Slider(0.5, range=0..1)
angualar_vel = Slider(0.3, range=0..1)
ros = ROSConnect(ip="172.16.21.74", connect=Toggle(True))  # -> ros_client, is_connected; inputs port: Int32, connect: Boolean
#   port ip: The ip address ROS. Defaults to 127.0.0.1.
#   port port: The port of ROS. Defaults to 9090.
#   port connect: If True, connects to ROS. If False, disconnects from ROS. Defaults to False.
#   port ros_client: The ROS client.
#   port is_connected: True if connection established.
# ---------- ros: Python ----------
"""
Connect or disconnect to ROS.

COMPAS FAB v0.27.0
"""
from ghpythonlib.componentbase import executingcomponent as component
from scriptcontext import sticky as st

from compas_fab.backends import RosClient
from compas_fab.ghpython.components import create_id


class ROSConnect(component):
    def RunScript(self, ip, port, connect):
        ros_client = None

        ip = ip or '127.0.0.1'
        port = port or 9090

        key = create_id(self, 'ros_client')
        ros_client = st.get(key, None)

        if ros_client:
            st[key].close()
        if connect:
            st[key] = RosClient(ip, port)
            st[key].run(5)

        ros_client = st.get(key, None)
        is_connected = ros_client.is_connected if ros_client else False
        return (ros_client, is_connected)
# ---------- end ros ----------
ros_2 = ROSConnect(ip="172.16.21.60", connect=Toggle(True))  # -> ros_client, is_connected; inputs port: Int32, connect: Boolean; same code as ros
create_msg = GhPythonScript(lin=linear_vel, ang=angualar_vel)  # -> out, msg
# ---------- create_msg: Python ----------
__author__ = "vince"
__version__ = "2022.12.12"

import rhinoscriptsyntax as rs
import json

def create_twist_msg():
    twist_msg ={'linear': {'x': lin, 'y':0.0 , 'z':0.0 }, 
                   'angular': {'x':0.0, 'y': 0.0, 'z': ang}}
    return json.dumps(twist_msg)

msg = create_twist_msg()
# ---------- end create_msg ----------
trigger = Trigger(Interval=1000, TimerInterval=1000, Target=publish)  # disabled
subscribe = SubscribeToTopic(ros_client=ros.ros_client, topic_name="/turtle1/pose", topic_type="/turtlesim/Pose", start=Button(), stop=Button())  # -> topic, last_msg, is_subscribed; inputs interval: Int32, start: Boolean, stop: Boolean
#   port ros_client: The ROS client.
#   port topic_name: Name of the topic to subscribe to, eg. /joint_states
#   port topic_type: Type of the topic to subscribe to, eg. sensor_msgs/JointState
#   port interval: Interval in milliseconds at which to expire the solution to propagate received messages. Defaults to 25ms. Messages are not queued, so if the interval is greater than the rate at which messages are published, some messages will be dropped.
#   port start: Start receiving messages.
#   port stop: Stop receiving messages.
#   port topic: The subscribed topic instance.
#   port last_msg: The last received message.
#   port is_subscribed: Indicates if the topic is currently subscribed or not.
# ---------- subscribe: Python ----------
"""
Subscribe to a ROS topic.

COMPAS FAB v0.27.0
"""
import time

import Grasshopper.Kernel
from ghpythonlib.componentbase import executingcomponent as component
from roslibpy import Topic
from scriptcontext import sticky as st

from compas_fab.backends.ros.messages import ROSmsg
from compas_fab.ghpython.components import create_id


class ROSTopicSubscribe(component):
    def RunScript(self, ros_client, topic_name, topic_type, interval, start, stop):
        if not topic_name:
            raise ValueError('Please specify the name of the topic')
        if not topic_type:
            raise ValueError('Please specify the type of the topic')

        if not hasattr(self, 'message_count'):
            self.message_count = 0

        self.interval = interval or 25  # in milliseconds
        self.is_updating = False
        self.is_subscribed = False

        self.msg_key = create_id(self, 'last_msg')
        key = create_id(self, 'topic')

        last_msg = st.get(self.msg_key, None)
        topic = st.get(key, None)

        if ros_client and ros_client.is_connected:
            if start:
                self._unsubscribe(topic)

                topic = Topic(ros_client, topic_name, topic_type)
                topic.subscribe(self.topic_callback)
                time.sleep(0.2)

                st[key] = topic

            if stop:
                self._unsubscribe(topic)

        self.is_subscribed = topic and topic.is_subscribed

        if last_msg:
            last_msg = ROSmsg.parse(last_msg, topic_type)

        if self.is_subscribed:
            self.Message = 'Subscribed, {} messages'.format(self.message_count)
        else:
            self.Message = 'Not subscribed'

        return (topic, last_msg, self.is_subscribed)

    def _unsubscribe(self, topic):
        if topic and topic.is_subscribed:
            topic.unsubscribe()
            time.sleep(0.2)

    def topic_callback(self, msg):
        self.message_count += 1
        st[self.msg_key] = msg

        if self.is_subscribed:
            ghdoc = ghenv.Component.OnPingDocument()     # noqa: F821 This is defined by Grasshopper
            if not self.is_updating and ghdoc.SolutionState != Grasshopper.Kernel.GH_ProcessStep.Process:
                self.is_updating = True
                ghdoc.ScheduleSolution(
                    self.interval, Grasshopper.Kernel.GH_Document.GH_ScheduleDelegate(self.expire_callback))

    def expire_callback(self, ghdoc):
        if ghdoc.SolutionState != Grasshopper.Kernel.GH_ProcessStep.Process:
            ghenv.Component.ExpireSolution(False)        # noqa: F821 This is defined by Grasshopper
        self.is_updating = False
# ---------- end subscribe ----------
publish = PublishToTopic(ros_client=ros.ros_client, topic_name="/turtle1/cmd_vel", topic_type="/geometry_msgs/Twist", msg=create_msg.msg)  # -> topic, is_advertised
#   port ros_client: The ROS client.
#   port topic_name: Name of the topic to publish to, eg. /joint_states
#   port topic_type: Type of the topic to publish to, eg. sensor_msgs/JointState
#   port msg: The message to publish. It can be an instance of ROSMsg, a Python dict, or a JSON string.
#   port topic: The topic instance.
#   port is_advertised: Indicates if the topic is current advertised or not.
# ---------- publish: Python ----------
"""
Publishes messages to a ROS topic

COMPAS FAB v0.27.0
"""
import time

from ghpythonlib.componentbase import executingcomponent as component
from roslibpy import Topic
from scriptcontext import sticky as st

from compas_fab.backends.ros.messages import ROSmsg
from compas_fab.ghpython.components import create_id


class ROSTopicPublish(component):
    def RunScript(self, ros_client, topic_name, topic_type, msg):
        if not topic_name:
            raise ValueError('Please specify the name of the topic')
        if not topic_type:
            raise ValueError('Please specify the type of the topic')

        key = create_id(self, 'topic')

        topic = st.get(key, None)

        if ros_client and ros_client.is_connected:
            if not topic or topic.ros != ros_client:
                topic = Topic(ros_client, topic_name, topic_type, reconnect_on_close=False)
                topic.advertise()
                time.sleep(0.2)

                st[key] = topic

        self.is_advertised = topic and topic.is_advertised

        if msg:
            msg = ROSmsg.parse(msg, topic_type)
            topic.publish(msg.msg)
            self.Message = 'Message published'
        else:
            if self.is_advertised:
                self.Message = 'Topic advertised'

        return (topic, self.is_advertised)
# ---------- end publish ----------
subscribe_2 = SubscribeToTopic(
    ros_client=ros_2.ros_client,
    topic_name="/joint_states",
    topic_type="/sensor_msgs/JointState",
    start=Button(),
    stop=Button())  # -> topic, last_msg, is_subscribed; inputs interval: Int32, start: Boolean, stop: Boolean; same code as subscribe
parse_msg = GhPythonScript(msg=subscribe.last_msg)  # -> out, x, y
# ---------- parse_msg: Python ----------
__author__ = "vince"
__version__ = "2022.12.12"



import rhinoscriptsyntax as rs
from compas_fab.backends.ros.messages import ROSmsg

if msg is not None:
    x = msg.x
    y = msg.y
# ---------- end parse_msg ----------
panel = Panel(subscribe_2.last_msg)
pt = ConstructPoint(XCoordinate=parse_msg.x, YCoordinate=parse_msg.y, ZCoordinate=0)
websocket_client_start = WebsocketClientStart(Address="ws://172.16.21.60:9090/", InitalMessage="Hello World", Reset=Button())
subscribe_3 = Subscribe(Topic="/joint_states")  # -> R
# ---------- subscribe_3: Python ----------
import json


data = {
"op":"subscribe",
"topic":Topic
}

R = json.dumps(data)
# ---------- end subscribe_3 ----------
websocket_client_receiver = WebsocketClientReceiver(WebsocketObjects=websocket_client_start, AutoUpdate=True)  # -> Message, Status
websocket_client_sender = WebsocketClientSender(WebsocketObjects=websocket_client_start, Message=subscribe_3)
panel_2 = Panel(websocket_client_receiver.Message)
