# Grasshopper definition yaml_writer.gh (Grasshopper 1.0.7)

# YAML writer
number_slider = Slider(841, range=0..10000)
# WIP
number_slider_2 = Slider(1000, range=0..1000)
number_slider_3 = Slider(85, range=0..100)
series = Series(Start=expr("-4*X", number_slider_3), Step=number_slider_3, Count=10)
pt = ConstructPoint(XCoordinate=number_slider, YCoordinate=0, ZCoordinate=Slider(253, range=0..1000))
pt_2 = ConstructPoint(XCoordinate=number_slider_2, YCoordinate=series, ZCoordinate=0)
X = UnitX(Factor=1)
polygon = Polygon(Plane=pt, Radius=Slider(216, range=0..1000), Segments=6, FilletRadius=0)  # -> Polygon, Length
line = LineSDL(Start=pt_2, Direction=X, Length=Slider(500, range=0..1000))
divide = DivideCurve(Curve=polygon.Polygon, Count=1, Kinks=True)  # -> Points, Tangents, Parameters
dispatch = Dispatch(List=line, DispatchPattern=[True, False])  # -> ListA, ListB
flip = FlipCurve(Curve=dispatch.ListB)  # -> Curve, Flag
pl = ConstructPlane(Origin=divide.Points, XAxis=expr("-x", Vector(1, 0, 0)), YAxis=Vector(0, 1, 0))
xy = XYPlane(Origin=Point(0, 0, 0))
weave = Weave(Pattern=[0, 1], Stream0=dispatch.ListA, Stream1=flip.Curve, NullGaps=False)
python = GhPythonScript(file_path="C:\Users\vince\Desktop\poses.yaml", writeYaml=Button(), origin=xy, planes=simplify(graft(pl)))  # -> out, yaml; inputs writeYaml: Boolean, origin: Plane, planes: tree of Plane
# ---------- python: Python ----------
# inputs > name/typehint/access 
#   > file_path/string/item
#   > write_yaml/boolean/item
#   > origin/plane/item
#   > planes/plane/tree 
# 
# planes list must structured so that each branch 
# contains 1(Lin) or 2(Circ)


import rhinoscriptsyntax as rs
import Rhino.Geometry as rg
import ghpythonlib.treehelpers as th
import math

# rhino mm -> ros m
SCALE = 0.001
# euler conversion
UNIT_TOL = float(0.000001)

def pose(frame_origin, frame, frame_id):
    pose = ['%s' % frame_id,
                set_pose_point(frame_origin,frame),
                # set_pose_euler(frame_origin, frame)
                set_pose_quaternion(frame_origin, frame)]
    return pose

def set_pose_point(frame_origin, frame):
    frame.Origin = frame.Origin - frame_origin.Origin 
    point = [str(frame.OriginX * SCALE), str(frame.OriginY * SCALE),
                str(frame.OriginZ * SCALE)]
    return point

def set_pose_euler(frame_origin, frame):
    matrix = rg.Transform.PlaneToPlane(frame_origin, frame)
    a = math.atan2(-matrix.M10, matrix.M00)
    mult = 1.0 - matrix.M20 * matrix.M20

    if abs(mult) < UNIT_TOL:
        mult = 0.0
    b = math.atan2(matrix.M20, math.sqrt(mult))
    c = math.atan2(-matrix.M21, matrix.M22)
    if matrix.M20 < (-1.0 + UNIT_TOL):
        a = math.atan2(matrix.M01, matrix.M11)
        b = -math.pi / 2
        c = 0
    elif matrix.M20 > (1.0 - UNIT_TOL):
        a = math.atan2(matrix.M01, matrix.M11)
        b = math.pi / 2
        c = 0
    return [str(a), str(b), str(c)]

def set_pose_quaternion(frame_origin, frame):
    matrix = rg.Transform.PlaneToPlane(frame_origin, frame).Transpose()
    trace = matrix.M00 + matrix.M11 + matrix.M22

    q = rg.Quaternion()

    if trace > 0.0:
        s = math.sqrt(trace + 1.0)
        q.A = s * 0.5
        s = 0.5 / s
        q.B = (matrix.M12 - matrix.M21) * s
        q.C = (matrix.M20 - matrix.M02) * s
        q.D = (matrix.M01 - matrix.M10) * s
    else:
        if matrix.M00 >= matrix.M11 and matrix.M00 >= matrix.M22:
            s = math.sqrt(1.0 + matrix.M00 - matrix.M11 - matrix.M22)
            inv_s = 0.5 / s
            q.B = 0.5 * s
            q.C = (matrix.M01 + matrix.M10) * inv_s
            q.D = (matrix.M02 + matrix.M20) * inv_s
            q.A = (matrix.M12 - matrix.M21) * inv_s
        elif matrix.M11 > matrix.M22:
            s = math.sqrt(1.0 + matrix.M11 - matrix.M00 - matrix.M22)
            inv_s = 0.5 / s
            q.B = (matrix.M10 + matrix.M01) * inv_s
            q.C = 0.5 * s
            q.D = (matrix.M21 + matrix.M12) * inv_s
            q.A = (matrix.M20 - matrix.M02) * inv_s
        else:
            s = math.sqrt(1.0 + matrix.M22 - matrix.M00 - matrix.M11)
            inv_s = 0.5 / s
            q.B = (matrix.M20 + matrix.M02) * inv_s
            q.C = (matrix.M21 + matrix.M12) * inv_s
            q.D = 0.5 * s
            q.A = (matrix.M01 - matrix.M10) * inv_s

    return [str(q.B), str(q.C), str(q.D), str(q.A)]

def path_to_str(_origin, frames):
    path_str = ''
    for idx, frame in enumerate(frames):
        if len(frame) == 1:
            frame = plane_to_pose_str(_origin,frame[0],str(idx))
            path_str += frame
        elif len(frame) == 2:
            frame = plane_pair_to_pose_str(_origin,frame[0],frame[1],str(idx))
            path_str += frame
        else:
            print 'branches should contain 1 or 2 items'
            return
    return path_str[:-1]

def plane_to_pose_str(frame_origin, frame, idx):
    frame = pose(frame_origin,frame,str(idx))
    frame = ' - pose_id: %s\n   position: [%s, %s , %s]\n   quaternion: [%s, %s, %s, %s]\n' % (frame[0],
    frame[1][0], frame[1][1], frame[1][2],
    frame[2][0], frame[2][1], frame[2][2], frame[2][3])

    return frame

def plane_pair_to_pose_str(frame_origin, frame0, frame1, idx):
    frame0 = pose(frame_origin,frame0,str(idx))
    frame1 = pose(frame_origin,frame1,str(idx))

    frame0 = ' - pose_pair_id: %s\n   position: [%s, %s , %s]\n   quaternion: [%s, %s, %s, %s]\n' % (frame0[0],
    frame0[1][0], frame0[1][1], frame0[1][2],
    frame0[2][0], frame0[2][1], frame0[2][2], frame0[2][3])

    frame1 = '   centre_position: [%s, %s , %s]\n   centre_quaternion: [%s, %s, %s, %s]\n' % (frame1[1][0], 
    frame1[1][1], frame1[1][2],
    frame1[2][0], frame1[2][1], frame1[2][2], frame1[2][3])

    return frame0+frame1

def write_yaml(file_path,string):
    with open(file_path,"w") as file:
            file.write(string)

def main(origin, planes):
    planes.SimplifyPaths()
    planes = th.tree_to_list(planes, retrieve_base=None)
    path = path_to_str(origin, planes)
    header = 'path:\n'
    toolpath = header+path
    yaml = toolpath
    write_yaml(file_path,toolpath)
    print('yaml file generated')

if writeYaml:
    main(origin, planes)
# ---------- end python ----------
divide_2 = DivideCurve(Curve=weave, Count=1, Kinks=False)  # -> flatten(Points), Tangents, Parameters
cull_i = CullIndex(List=divide_2.Points, Indices=[0, -1], Wrap=True)
partition = PartitionList(List=cull_i, Size=2)
item = ListItem(List=partition, Index=0, Wrap=True)  # -> Item, Item1
lng = ListLength(List=flatten(item.Item))
X_2 = UnitX(Factor=1)
rev = Reverse(Vector=X_2)
merge = Merge(Data1=X_2, Data2=rev)
repeat = RepeatData(Data=merge, Length=lng)  # -> graft(Data)
arc = ArcSED(Start=item.Item, End=item.Item1, Direction=repeat)  # -> flatten(Arc), Plane, Radius
line_2 = Line(weave)
shatter = Shatter(Curve=reparameterize(arc.Arc), Parameters=0.5)  # -> flatten(Segments)
weave_2 = Weave(Pattern=[0, 1, 1], Stream0=line_2, Stream1=shatter, NullGaps=False)
geo = Geometry(simplify(graft(weave_2)))
txt = Text(geo)
eval = Evaluate(F="Contains(x,\"Line\")", x=txt)
dispatch_2 = Dispatch(List=geo, DispatchPattern=eval)  # -> ListA, ListB
clean = CleanTree(RemoveNulls=True, RemoveInvalid=True, RemoveEmpty=True, Tree=dispatch_2.ListB)
clean_2 = CleanTree(RemoveNulls=True, RemoveInvalid=True, RemoveEmpty=True, Tree=dispatch_2.ListA)
branch = TreeBranch(Tree=geo, Path="{0}", MaintainPaths=True)
divide_3 = DivideCurve(Curve=branch, Count=1, Kinks=False)  # -> Points, Tangents, Parameters
divide_4 = DivideCurve(Curve=clean_2, Count=1, Kinks=False)  # -> simplify(Points), Tangents, Parameters
divide_5 = DivideCurve(Curve=clean, Count=2, Kinks=False)  # -> simplify(Points), Tangents, Parameters
item_2 = ListItem(List=divide_3.Points, Index=0, Wrap=True)
item_3 = ListItem(List=divide_4.Points, Index=1, Wrap=True)
item_4 = ListItem(List=divide_5.Points, Index=[1, 2], Wrap=True)
merge_2 = Merge(Data2=item_3, Data3=item_4)
path_mapper = PathMapper(item_2, source="{A;B}", target="{A}")
path_mapper_2 = PathMapper(merge_2, source="{A}", target="{A+1}")
merge_3 = Merge(Data1=path_mapper, Data2=path_mapper_2)
pl_2 = ConstructPlane(Origin=merge_3, XAxis=expr("-X", Vector(1, 0, 0)), YAxis=Vector(0, 1, 0))
xy_2 = XYPlane(Origin=Point(0, 0, 0))
python_2 = GhPythonScript(file_path="C:\Users\vince\Desktop\poses_c.yaml", writeYaml=Button(), origin=xy_2, planes=simplify(pl_2))  # -> out, a; inputs writeYaml: Boolean, origin: Plane, planes: tree of Plane
# ---------- python_2: Python ----------
# inputs > name/typehint/access 
#   > file_path/string/item
#   > write_yaml/boolean/item
#   > origin/plane/item
#   > planes/plane/tree 
# 
# planes list must structured so that each branch 
# contains 1(Lin) or 2(Circ)


import rhinoscriptsyntax as rs
import Rhino.Geometry as rg
import ghpythonlib.treehelpers as th
import math

# rhino mm -> ros m
SCALE = 0.001
# euler conversion
UNIT_TOL = float(0.000001)

def pose(frame_origin, frame, frame_id):
    pose = ['%s' % frame_id,
                set_pose_point(frame_origin,frame),
                # set_pose_euler(frame_origin, frame)
                set_pose_quaternion(frame_origin, frame)]
    return pose

def set_pose_point(frame_origin, frame):
    frame.Origin = frame.Origin - frame_origin.Origin 
    point = [str(frame.OriginX * SCALE), str(frame.OriginY * SCALE),
                str(frame.OriginZ * SCALE)]
    return point

def set_pose_euler(frame_origin, frame):
    matrix = rg.Transform.PlaneToPlane(frame_origin, frame)
    a = math.atan2(-matrix.M10, matrix.M00)
    mult = 1.0 - matrix.M20 * matrix.M20

    if abs(mult) < UNIT_TOL:
        mult = 0.0
    b = math.atan2(matrix.M20, math.sqrt(mult))
    c = math.atan2(-matrix.M21, matrix.M22)
    if matrix.M20 < (-1.0 + UNIT_TOL):
        a = math.atan2(matrix.M01, matrix.M11)
        b = -math.pi / 2
        c = 0
    elif matrix.M20 > (1.0 - UNIT_TOL):
        a = math.atan2(matrix.M01, matrix.M11)
        b = math.pi / 2
        c = 0
    return [str(a), str(b), str(c)]

def set_pose_quaternion(frame_origin, frame):
    matrix = rg.Transform.PlaneToPlane(frame_origin, frame).Transpose()
    trace = matrix.M00 + matrix.M11 + matrix.M22

    q = rg.Quaternion()

    if trace > 0.0:
        s = math.sqrt(trace + 1.0)
        q.A = s * 0.5
        s = 0.5 / s
        q.B = (matrix.M12 - matrix.M21) * s
        q.C = (matrix.M20 - matrix.M02) * s
        q.D = (matrix.M01 - matrix.M10) * s
    else:
        if matrix.M00 >= matrix.M11 and matrix.M00 >= matrix.M22:
            s = math.sqrt(1.0 + matrix.M00 - matrix.M11 - matrix.M22)
            inv_s = 0.5 / s
            q.B = 0.5 * s
            q.C = (matrix.M01 + matrix.M10) * inv_s
            q.D = (matrix.M02 + matrix.M20) * inv_s
            q.A = (matrix.M12 - matrix.M21) * inv_s
        elif matrix.M11 > matrix.M22:
            s = math.sqrt(1.0 + matrix.M11 - matrix.M00 - matrix.M22)
            inv_s = 0.5 / s
            q.B = (matrix.M10 + matrix.M01) * inv_s
            q.C = 0.5 * s
            q.D = (matrix.M21 + matrix.M12) * inv_s
            q.A = (matrix.M20 - matrix.M02) * inv_s
        else:
            s = math.sqrt(1.0 + matrix.M22 - matrix.M00 - matrix.M11)
            inv_s = 0.5 / s
            q.B = (matrix.M20 + matrix.M02) * inv_s
            q.C = (matrix.M21 + matrix.M12) * inv_s
            q.D = 0.5 * s
            q.A = (matrix.M01 - matrix.M10) * inv_s

    return [str(q.A), str(q.B), str(q.C), str(q.D)]

def path_to_str(_origin, frames):
    path_str = ''
    for idx, frame in enumerate(frames):
        if len(frame) == 1:
            frame = plane_to_pose_str(_origin,frame[0],str(idx))
            path_str += frame
        elif len(frame) == 2:
            frame = plane_pair_to_pose_str(_origin,frame[0],frame[1],str(idx))
            path_str += frame
        else:
            print 'branches should contain 1 or 2 items'
            return
    return path_str[:-1]

def plane_to_pose_str(frame_origin, frame, idx):
    frame = pose(frame_origin,frame,str(idx))
    frame = ' - pose_id: %s\n   position: [%s, %s , %s]\n   quaternion: [%s, %s, %s, %s]\n' % (frame[0],
    frame[1][0], frame[1][1], frame[1][2],
    frame[2][0], frame[2][1], frame[2][2], frame[2][3])

    return frame

def plane_pair_to_pose_str(frame_origin, frame0, frame1, idx):
    frame0 = pose(frame_origin,frame0,str(idx))
    frame1 = pose(frame_origin,frame1,str(idx))

    frame0 = ' - pose_pair_id: %s\n   position: [%s, %s , %s]\n   quaternion: [%s, %s, %s, %s]\n' % (frame0[0],
    frame0[1][0], frame0[1][1], frame0[1][2],
    frame0[2][0], frame0[2][1], frame0[2][2], frame0[2][3])

    frame1 = '   centre_position: [%s, %s , %s]\n   centre_quaternion: [%s, %s, %s, %s]\n' % (frame1[1][0], 
    frame1[1][1], frame1[1][2],
    frame1[2][0], frame1[2][1], frame1[2][2], frame1[2][3])

    return frame0+frame1

def write_yaml(file_path,string):
    with open(file_path,"w") as file:
            file.write(string)

def main(origin, planes):
    planes.SimplifyPaths()
    planes = th.tree_to_list(planes, retrieve_base=None)
    path = path_to_str(origin, planes)
    header = 'path:\n'
    toolpath = header+path
    write_yaml(file_path,toolpath)
    print('yaml file generated')

if writeYaml:
    main(origin, planes)
# ---------- end python_2 ----------
